# Grasshopper definition convert_landscape2.gh (Grasshopper 1.0.7)
# plug-ins: Human

file_path = FilePath("C:\Users\JACINTO MOROS\Downloads\heightmapper-1646848987325.png")
serialize_image_to_string = SerializeImageToString(ImagePath=file_path)
resolucion_de_la_imagen = Slider(5, range=1..100)
upload_image = GetString(serialize_image_to_string, AtLeast=1, AtMost=1)
deserialize_image_from_string = DeserializeImageFromString(ImageString=upload_image)
resolution = GetNumber(resolucion_de_la_imagen, AtLeast=1, AtMost=2147483647, Maximum=1.797693135e+308, Minimum=-1.797693135e+308)
import_image = ImportImage(File=deserialize_image_from_string)
bounding_box = BoundingBox(Content=import_image, Plane=PlaneXY(0, 0, 0))  # -> Box, Box_2
dimensions = Dimensions(Surface=bounding_box.Box)  # -> UDimension, VDimension
division = Division(A=dimensions.UDimension, B=resolution)
division_2 = Division(A=dimensions.VDimension, B=resolution)
import_image_2 = ImportImage(File=deserialize_image_from_string, XSamples=division, YSamples=division_2)
deconstruct_mesh = DeconstructMesh(Mesh=import_image_2)  # -> Vertices, Faces, Colours, Normals
split_ahsl = SplitAHSL(Colour=deconstruct_mesh.Colours)  # -> Alpha, Hue, Saturation, Luminance
construct_domain = ConstructDomain(DomainStart=0, DomainEnd="100")
deconstruct = Deconstruct(Point=deconstruct_mesh.Vertices)  # -> XComponent, YComponent, ZComponent
remap_numbers = RemapNumbers(Value=split_ahsl.Luminance, Source=Domain(0, 1), Target=construct_domain)  # -> Mapped, Clipped
construct_point = ConstructPoint(XCoordinate=deconstruct.XComponent, YCoordinate=deconstruct.YComponent, ZCoordinate=remap_numbers.Mapped)
gradient = Gradient(
    LowerLimit=0,
    UpperLimit="100",
    Parameter=remap_numbers.Mapped,
    stops=[0: RGB(41, 141, 255), 0.121: RGB(205, 222, 111), 0.209: RGB(141, 173, 76), 0.3: RGB(86, 145, 67), 0.43: RGB(72, 107, 39), 1: RGB(255, 255, 255)])
construct_mesh = ConstructMesh(Vertices=construct_point, Faces=deconstruct_mesh.Faces, Colours=gradient)

# ---- group: RH_OUT:Terrain
mesh = Mesh(construct_mesh)
