# Grasshopper definition import_terrain_02.gh (Grasshopper 1.0.7)

resolucion_de_la_imagen = Slider(8, range=1..100)
m = Slider(120, range=0..200)
path = FilePath("D:\MASTER IAAC\BIMSC21\CLOUD-BASED DATA MANAGMENT[CRHINO.COMPUTE]\WEEK 01\HOPS\Heightmapper\Example Images\heightmapper-1641918600508.png")
resolution_image = GetInteger(resolucion_de_la_imagen, AtLeast=1, AtMost=2147483647, Maximum=100, Minimum=-2147483648)
maximum_height = GetNumber(m, AtLeast=1, AtMost=2147483647, Maximum=1.797693135e+308, Minimum=-1.797693135e+308)
image_file = GetString(path, AtLeast=1, AtMost=1)
import_image = ImportImage(File=image_file)
bounding_box = BoundingBox(Content=import_image, Plane=PlaneXY(0, 0, 0))  # -> Box, Box_2
dimensions = Dimensions(Surface=bounding_box.Box)  # -> UDimension, VDimension
division = Division(A=dimensions.UDimension, B=resolution_image)
division_2 = Division(A=dimensions.VDimension, B=resolution_image)
import_image_2 = ImportImage(File=image_file, XSamples=division, YSamples=division_2)
deconstruct_mesh = DeconstructMesh(Mesh=import_image_2)  # -> Vertices, Faces, Colours, Normals
split_ahsl = SplitAHSL(Colour=deconstruct_mesh.Colours)  # -> Alpha, Hue, Saturation, Luminance
construct_domain = ConstructDomain(DomainStart=0, DomainEnd=maximum_height)
deconstruct = Deconstruct(Point=deconstruct_mesh.Vertices)  # -> XComponent, YComponent, ZComponent
remap_numbers = RemapNumbers(Value=split_ahsl.Luminance, Source=Domain(0, 1), Target=construct_domain)  # -> Mapped, Clipped
construct_point = ConstructPoint(XCoordinate=deconstruct.XComponent, YCoordinate=deconstruct.YComponent, ZCoordinate=remap_numbers.Mapped)
gradient = Gradient(
    LowerLimit=0,
    UpperLimit="100",
    Parameter=remap_numbers.Mapped,
    stops=[0: RGB(41, 141, 255), 0.121: RGB(205, 222, 111), 0.209: RGB(141, 173, 76), 0.3: RGB(86, 145, 67), 0.43: RGB(72, 107, 39), 1: RGB(255, 255, 255)])
construct_mesh = ConstructMesh(Vertices=construct_point, Faces=deconstruct_mesh.Faces, Colours=gradient)

# ---- group: RH_OUT:Terrain
mesh = Mesh(construct_mesh)
